# Grasshopper definition makeWaveFromImg.gh (Grasshopper 0.9.80)
# plug-ins: Pufferfish

number_slider = Slider(217, range=0..1000)
number_slider_2 = Slider(4, range=0..10)
number_slider_3 = Slider(1, range=0..10)
number_slider_4 = Slider(5, range=0..10)
img = ImportImage(File="/Users/m0rya/theOne/myOwnPrj/Rhino-prj/2-5Pazzle/src/assets/hoge.3.jpg")
img_2 = ImportImage(File="/Users/m0rya/theOne/myOwnPrj/Rhino-prj/2-5Pazzle/src/assets/perlin.tiff")
panel = Panel("Scale")
panel_2 = Panel("Height")
panel_3 = Panel("""リファクタリング

パラメータ整理

切り取る範囲を簡単に設定できるようにする。

////なにか新しい機能を加えたいなぁ

・新しいつなぎ目部分の開発
・新しい分割方法(Delauney)""")
cluster = Cluster_3(X=number_slider, Y=number_slider, N=Slider(50, range=0..100), B=Slider(11, range=0..100), A_2=Slider(5, range=0..10))  # -> rec_2, A, vec_2, R, pt_3, crv_5
cluster_2 = Cluster(mesh=img, F=Slider(2, range=0..10), B=Slider(800, range=0..1000))  # -> O, mesh_4
cluster_3 = Cluster_2(
    L=cluster.pt_3,
    d1=number_slider_2,
    x_2=number_slider_2,
    x_3=number_slider_3,
    d2=number_slider_3,
    B=Slider(2, range=0..10),
    d1_2=number_slider_4,
    x=number_slider_4,
    Y=Slider(4, range=0..20),
    Y_2=Slider(4, range=0..20),
    Y_3=Slider(5, range=0..10))  # -> C, C_2
preview = CustomPreview(
    Geometry=cluster_2.mesh_4,
    Shader={ambient=RGB(0, 0, 0), diffuse=RGB(255, 105, 180), emission=RGB(76, 32, 54), shine=0.5, specular=RGB(255, 255, 255), transparency=0})
crv = Curve(cluster_3.C)
crv_2 = Curve(cluster_3.C_2)
cluster_4 = Cluster_4(
    G=crv,
    C_3=crv,
    L=cluster.R,
    L_2=cluster.R,
    P=cluster.R,
    P_2=cluster.vec_2,
    C=cluster.crv_5,
    C_2=cluster.crv_5,
    crv=cluster.A)
cluster_5 = Cluster_5(x=Slider(0.2, range=-0.5..0.5), C=cluster_4, B=Slider(5, range=0..10), crv=cluster.rec_2)
crv_3 = Curve(cluster_5)
Z = UnitZ(Factor="200")
extr = Extrude(Base=crv_3, Direction=Z)
Z_2 = UnitZ(Factor="-10")
move = Move(Geometry=extr, Motion=Z_2)  # -> Geometry, Transform
brep = Brep(move.Geometry)
cap = CapHoles(Brep=brep)
smooth = SettingsQuality()

mesh = Mesh(cluster_2.mesh_4)
mesh_2 = Mesh(cluster_2.O)

mesh_3 = MeshBrep(Brep=cap, Settings=smooth)

mdif = MeshDifference(MeshesA=mesh_3, MeshesB=mesh_2)  # disabled
mdif_2 = MeshDifference(MeshesA=cap, MeshesB=mesh_2)  # disabled

mesh_4 = Mesh(mdif_2)
mshclsd = IsMeshClosed(Mesh=mdif)
mshclsd_2 = IsMeshClosed(Mesh=mesh_4)
dispatch = Dispatch(List=mdif, DispatchPattern=mshclsd)  # -> ListA, ListB
dispatch_2 = Dispatch(List=mesh_4, DispatchPattern=mshclsd_2)  # -> ListA, ListB
mesh_5 = Mesh(dispatch.ListB)
mesh_6 = Mesh(dispatch_2.ListB)

# ==== cluster Cluster
mesh = ClusterInput()
mesh_2 = Mesh(mesh)
demesh = DeconstructMesh(Mesh=mesh_2)  # -> Vertices, Faces, Colours, Normals
B = ClusterInput()
vec = VectorXYZ(XComponent=0, YComponent=0, ZComponent=0)  # -> Vector, Length
dom = ConstructDomain(DomainStart="0", DomainEnd=B)
dist = Distance(PointA=demesh.Colours, PointB=vec.Vector)
dom_2 = ConstructDomain(DomainStart="0", DomainEnd="255")
remap = RemapNumbers(Value=dist, Source=dom_2, Target=dom)  # -> Mapped, Clipped
pdecon = Deconstruct(Point=demesh.Vertices)  # -> XComponent, YComponent, ZComponent
vec_2 = VectorXYZ(XComponent=pdecon.XComponent, YComponent=pdecon.YComponent, ZComponent=remap.Mapped)  # -> Vector, Length
conmesh = ConstructMesh(Vertices=vec_2.Vector, Faces=demesh.Faces)
F = ClusterInput()
scale = Scale(Geometry=conmesh, Center=Point(0, 0, 0), Factor=F)  # -> Geometry, Transform
mesh_3 = Mesh(scale.Geometry)
mesh_4 = ClusterOutput(mesh_3)
wbcatmullclark = WeaverbirdsCatmullClarkSubdivision(MeshCurves=mesh_3, Level="2", SmoothNakedEdges="2")
O = ClusterOutput(wbcatmullclark)

# ==== cluster Cluster_2
x = ClusterInput()
x_2 = ClusterInput()
x_3 = ClusterInput()
d1 = ClusterInput()
d2 = ClusterInput()
d1_2 = ClusterInput()
neg = Negative(Value=x)
neg_2 = Negative(Value=x_2)
neg_3 = Negative(Value=x_3)
vec = VectorXYZ(XComponent=0, YComponent=0, ZComponent=0)  # -> Vector, Length
merge = Merge(Data1=d1, Data2=neg_2)
merge_2 = Merge(Data1=neg_3, Data2=d2)
merge_3 = Merge(Data1=d1_2, Data2=neg)
Y = ClusterInput()
vec_2 = VectorXYZ(XComponent=merge, YComponent=Y, ZComponent=0)  # -> Vector, Length
neg_4 = Negative(Value=vec_2.Vector)
Y_2 = ClusterInput()
move = Move(Geometry=vec.Vector, Motion=neg_4)  # -> Geometry, Transform
vec_3 = VectorXYZ(XComponent=merge_2, YComponent=Y_2, ZComponent=0)  # -> Vector, Length
Y_3 = ClusterInput()
neg_5 = Negative(Value=vec_3.Vector)
vec_4 = VectorXYZ(XComponent=merge_3, YComponent=Y_3, ZComponent=0)  # -> Vector, Length
move_2 = Move(Geometry=move.Geometry, Motion=neg_5)  # -> Geometry, Transform
neg_6 = Negative(Value=vec_4.Vector)
graft = GraftTree(Tree=move.Geometry, IncludeEmptyLists=True, IncludeNullItems=True)
graft_2 = GraftTree(Tree=move_2.Geometry, IncludeEmptyLists=True, IncludeNullItems=True)
move_3 = Move(Geometry=move_2.Geometry, Motion=neg_6)  # -> Geometry, Transform
graft_3 = GraftTree(Tree=move_3.Geometry, IncludeEmptyLists=True, IncludeNullItems=True)
merge_4 = Merge(Data1=graft, Data2=graft_2, Data3=graft_3)
bang = ExplodeTree(Data=merge_4)  # -> Branch0, Branch1
rev = ReverseList(List=bang.Branch0)
pt = Point(vec.Vector)
pt_2 = Point(bang.Branch1)
L = ClusterInput()
merge_5 = Merge(Data1=flatten(rev), Data2=flatten(pt), Data3=flatten(pt_2))
lng = ListLength(List=flatten(L))
pt_3 = Point(merge_5)
python = PythonScript(x=lng)  # -> out, a
# ---------- python: Python ----------
__author__ = "mac"

import rhinoscriptsyntax as rs
import random



result = []

for i in range(x):
	result.append(rs.VectorCreate((0,0,0), (0,0,0)))

	for j in range(5):
		result.append(rs.VectorCreate((random.random(), 0,0), (0,0,0)))
	
	result.append(rs.VectorCreate((0,0,0), (0,0,0)))


		
a = result
# ---------- end python ----------
partition = PartitionList(List=python.a, Size="7")
B = ClusterInput()
multiplication = Multiplication(A=partition, B=B)
addition = Addition(A=multiplication, B=pt_3)
panel = Panel(partition)
intcrv = Interpolate(Vertices=addition, Degree=3, Periodic=False, KnotStyle=1)  # -> Curve, Length, Domain
intcrv_2 = Interpolate(Vertices=pt_3, Degree=3, Periodic=False, KnotStyle=1)  # -> Curve, Length, Domain
C = ClusterOutput(intcrv.Curve)
C_2 = ClusterOutput(intcrv_2.Curve)

# ==== cluster Cluster_3
X = ClusterInput()
Y = ClusterInput()
rectangle = Rectangle(Plane=PlaneXY(0, 0, 0), XSize=X, YSize=Y, Radius=0)  # -> Rectangle, Length
N = ClusterInput()
rec = Rectangle(rectangle.Rectangle)
rec_2 = ClusterOutput(rec)
pop2d = Populate2D(Region=rec, Count=N, Seed=1)
voronoi = Voronoi(Points=pop2d, Boundary=rec, BruteForceOverride=False)
explode = Explode(Curve=voronoi, Recursive=True)  # -> flatten(Segments), Vertices
dupln = RemoveDuplicateLines(Lines=explode.Segments, Tolerance=0.01)
B = ClusterInput()
len = Length(Curve=dupln)
smaller = SmallerThan(FirstNumber=len, SecondNumber=B)  # -> SmallerThan, OrEqualTo
dispatch = Dispatch(List=dupln, DispatchPattern=smaller.SmallerThan)  # -> ListA, ListB
A = ClusterOutput(dispatch.ListA)
crv = Curve(dispatch.ListB)
crv_2 = Curve(rec)
ccx = CurveCurve(CurveA=crv_2, CurveB=crv)  # -> Points, ParamsA, ParamsB
lng = ListLength(List=ccx.Points)
larger = LargerThan(FirstNumber=lng, SecondNumber="2")  # -> LargerThan, OrEqualTo
dispatch_2 = Dispatch(List=crv, DispatchPattern=flatten(larger.OrEqualTo))  # -> ListA, ListB
crv_3 = Curve(dispatch_2.ListB)
end = EndPoints(Curve=crv_3)  # -> Start, End
subtraction = Subtraction(A=end.Start, B=end.End)
unit = UnitVector(Vector=subtraction)
cluster = Mid(C=crv_3)
vec = Vector(unit)
A_2 = ClusterInput()
vec_2 = ClusterOutput(vec)
multiplication = Multiplication(A=A_2, B=vec)
neg = Negative(Value=multiplication)
addition = Addition(A=multiplication, B=cluster)
addition_2 = Addition(A=neg, B=cluster)
pt = Point(graft(addition))
pt_2 = Point(graft(addition_2))
crv_4 = Curve(graft(crv_3))
merge = Merge(Data1=pt, Data2=pt_2)  # -> simplify(Result)
pt_3 = ClusterOutput(pt_2)
crv_5 = ClusterOutput(crv_4)
R = ClusterOutput(merge)

# ==== cluster Cluster_4
P = ClusterInput()
C = ClusterInput()
crv_cp = CurveClosestPoint(Point=P, Curve=C)  # -> Point, simplify(Parameter), Distance
C_2 = ClusterInput()
shatter = Shatter(Curve=C_2, Parameters=crv_cp.Parameter)
cull_i = CullIndex(List=shatter, Indices="1", Wrap=True)
L = ClusterInput()
L_2 = ClusterInput()
P_2 = ClusterInput()
C_3 = ClusterInput()
item = ListItem(List=L, Index=0, Wrap=True)
item_2 = ListItem(List=L_2, Index=1, Wrap=True)
pdecon = Deconstruct(Point=P_2)  # -> XComponent, YComponent, ZComponent
end = EndPoints(Curve=C_3)  # -> Start, End
subtraction = Subtraction(A=item, B=item_2)
smaller = SmallerThan(FirstNumber=pdecon.YComponent, SecondNumber="0")  # -> SmallerThan, OrEqualTo
subtraction_2 = Subtraction(A=end.Start, B=end.End)
python = PythonScript(x=smaller.SmallerThan)  # -> out, graft(a)
# ---------- python: Python ----------
__author__ = "mac"

import rhinoscriptsyntax as rs


if x == True:
	a = 1.0
else:
	a = -1.0
# ---------- end python ----------
angle = Angle(VectorA=subtraction_2, VectorB=subtraction)  # -> Angle, Reflex
multiplication = Multiplication(A=angle.Angle, B=python.a)
G = ClusterInput()
subtraction_3 = Subtraction(A=item, B=end.Start)
rotate = Rotate(Geometry=G, Angle=multiplication, Plane=end.Start)  # -> Geometry, Transform
dist = Distance(PointA=end.Start, PointB=end.End)
dist_2 = Distance(PointA=item, PointB=item_2)
move = Move(Geometry=rotate.Geometry, Motion=subtraction_3)  # -> Geometry, Transform
division = Division(A=dist_2, B=dist)
scale = Scale(Geometry=move.Geometry, Center=item, Factor=division)  # -> Geometry, Transform
crv = ClusterInput()
crv_2 = Curve(simplify(scale.Geometry))
crv_3 = Curve(simplify(cull_i))
crv_4 = Curve(crv)
join = JoinCurves(Curves=simplify([crv_3, crv_2]), Preserve=False)
merge = Merge(Data1=flatten(join), Data2=flatten(crv_4))  # -> flatten(Result)
R = ClusterOutput(merge)

# ==== cluster Cluster_5
x = ClusterInput()
neg = Negative(Value=x)
merge = Merge(Data1=x, Data2=neg)  # -> graft(Result)
panel = Panel(merge)
C = ClusterInput()
offset = Offset(Curve=C, Distance=merge, Plane=PlaneXY(0, 0, 0), Corners=1)  # -> flatten(Curve)
ccx = CurveCurve(CurveA=graft(offset), CurveB=offset)  # -> Points, ParamsA, ParamsB
trim = TrimTree(Tree=ccx.ParamsA, Depth=1)
shatter = Shatter(Curve=graft(offset), Parameters=trim)  # -> simplify(Segments)
num = Number(x)
python = PythonScript(x=shatter)  # -> out, flatten(a); inputs x: list
# ---------- python: Python ----------
__author__ = "m0rya"

import rhinoscriptsyntax as rs



if len(x) >= 2:
	maxLen = 0
	result = None
	for i in x:
		tmpLen = rs.CurveLength(i)
		if tmpLen > maxLen:
			maxLen = tmpLen
			result = i
	a = result
	
		
elif len(x) == 1:
	a = x[0]
else:
	a = "Fuck"
# ---------- end python ----------
panel_2 = Panel(python.a)
lng = ListLength(List=shatter)
multiplication = Multiplication(A=num, B=2)
flatten = FlattenTree(Tree=python.a, Path="{0}")
addition = Addition(A=multiplication, B=0.02)
len = Length(Curve=flatten)
panel_3 = Panel(shatter)
crv = ClusterInput()
smaller = SmallerThan(FirstNumber=len, SecondNumber=addition)  # -> SmallerThan, OrEqualTo
panel_5 = Panel(lng)
crv_2 = Curve(crv)
dispatch = Dispatch(List=flatten, DispatchPattern=smaller.SmallerThan)  # -> ListA, ListB
crv_3 = Curve(crv_2)
crv_4 = Curve(python.a)
join = JoinCurves(Curves=crv_4, Preserve=False)
crv_5 = Curve(join)
cls = Closed(Curve=crv_5)  # -> Closed, Periodic
dispatch_2 = Dispatch(List=crv_5, DispatchPattern=cls.Closed)  # -> ListA, ListB
crv_6 = Curve(dispatch_2.ListB)
explode = Explode(Curve=crv_6, Recursive=True)  # -> Segments, Vertices
lng_2 = ListLength(List=explode.Segments)
smaller_2 = SmallerThan(FirstNumber=lng_2, SecondNumber="1")  # -> SmallerThan, simplify(OrEqualTo)
dispatch_3 = Dispatch(List=graft(crv_6), DispatchPattern=smaller_2.OrEqualTo)  # -> ListA, ListB
offset_2 = Offset(Curve=crv_3, Distance="-1", Plane=PlaneXY(0, 0, 0), Corners=1)
crv_7 = Curve(dispatch_3.ListB)
ccx_2 = CurveCurve(CurveA=crv_7, CurveB=offset_2)  # -> Points, ParamsA, flatten(ParamsB)
sort = SortList(Keys=ccx_2.ParamsB)  # -> Keys, ValuesA
trim_2 = TrimTree(Tree=ccx_2.ParamsA, Depth=1)
shatter_2 = Shatter(Curve=crv_7, Parameters=trim_2)
len_2 = Length(Curve=shatter_2)
B = ClusterInput()
bool = Boolean(True)
bool_2 = Boolean(False)
smaller_3 = SmallerThan(FirstNumber=len_2, SecondNumber=B)  # -> SmallerThan, OrEqualTo
shatter_3 = Shatter(Curve=offset_2, Parameters=sort.Keys)
panel_6 = Panel("""True
False""")
merge_2 = Merge(Data1=bool, Data2=bool_2)
dispatch_4 = Dispatch(List=shatter_2, DispatchPattern=smaller_3.SmallerThan)  # -> ListA, ListB
cull = CullPattern(List=shatter_3, CullPattern=merge_2)
crv_8 = Curve(dispatch_2.ListA)
crv_9 = Curve(dispatch_4.ListB)
ccx_3 = CurveCurve(CurveA=offset_2, CurveB=graft(crv_8))  # -> Points, ParamsA, ParamsB
crv_10 = Curve(cull)
trim_3 = TrimTree(Tree=ccx_3.ParamsB, Depth=1)  # -> simplify(Tree)
join_2 = JoinCurves(Curves=flatten([crv_9, crv_10]), Preserve=False)
null = NullItem(Item=trim_3)  # -> NullFlags, InvalidFlags, Description
panel_7 = Panel(crv_8)
dispatch_5 = Dispatch(List=graft(crv_8), DispatchPattern=null.NullFlags)  # -> ListA, ListB
shatter_4 = Shatter(Curve=graft(crv_8), Parameters=ccx_3.ParamsB)
clean = CleanTree(RemoveNulls=True, RemoveInvalid=True, RemoveEmpty=True, Tree=shatter_4)
len_3 = Length(Curve=clean)
crv_11 = Curve(join_2)
sort_2 = SortList(Keys=len_3, ValuesA=clean)  # -> Keys, ValuesA
crv_12 = Curve(dispatch_5.ListA)
cull_i = CullIndex(List=sort_2.ValuesA, Indices=0, Wrap=True)
clscrv = CloseCurve(Curve=cull_i, CloseType=0, Bulge=0.5, Tolerance=0)  # -> Closed, R
merge_3 = Merge(Data1=crv_12, Data2=clscrv.Closed)
merge_4 = Merge(Data1=crv_11, Data2=merge_3)  # -> flatten(Result)
R = ClusterOutput(merge_4)

# ==== cluster Mid
C = ClusterInput()
end = EndPoints(Curve=C)  # -> Start, End
addition = Addition(A=end.Start, B=end.End)
division = Division(A=addition, B=2)
R = ClusterOutput(division)
